# Grasshopper definition builder_test.gh (Grasshopper 1.0.8)
# plug-ins: Selva

ui_bridge = UIBridge(
    Enable=Toggle(True),
    Schema="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",
    SessionId="m0iEJ-Cv",
    Values="{\"e62a2ebe-2158-41c4-bf95-b31c862c5257\":true,\"4a7cf1b2-03d2-4894-97b3-c2da6d9209a9\":\"Sphere\",\"12e4b4b9-2767-426b-baa5-0a0e1bcd0a5b\":11,\"819a5bc3-2d58-4d65-b3fc-31626472385d\":10,\"ebb5a84e-f1ad-46f4-987d-a3050c8e51c8\":\"ffdfsdfsdff\",\"d5efe509-6e2e-4b83-bfdb-6ad50bc31001\":10}")  # -> SessionID, Info, Schema
context_print = ContextPrint(Schema=ui_bridge.Schema)

radius = Slider(7, range=0..20)
heigth = Slider(10, range=10..20)
width = Slider(10, range=10..20)
types = ValueList({"Sphere": 0, "Cylinder": 1, "Box": 2}, selected="Sphere")
get_string = GetString(AtLeast=1, AtMost=1, TreeAccess=False)
copy_up = GetBoolean("false", AtLeast=1, AtMost=1, FalseValue="False", TreeAccess=False, TrueValue="True")
radius_2 = GetNumber(radius, AtLeast=1, AtMost=1, Maximum=25, Minimum=5, TreeAccess=False)
width_2 = GetNumber(heigth, AtLeast=1, AtMost=1, Maximum=20, Minimum=5, TreeAccess=False)
heigth_2 = GetNumber(width, AtLeast=1, AtMost=1, Maximum=20, Minimum=5, TreeAccess=False)
get_value_list = GetValueList(
    types,
    AtLeast=1,
    AtMost=1,
    Immediate=True,
    StoredItems="""[
  {
    "name": "Sphere",
    "expression": "0"
  },
  {
    "name": "Cylinder",
    "expression": "1"
  },
  {
    "name": "Box",
    "expression": "2"
  }
]""",
    TreeAccess=False)
panel = Panel(copy_up)
cylinder = Cylinder(Base=PlaneXY(0, 0, 0), Radius=radius_2, Length=heigth_2)
sphere = Sphere(Base=PlaneXY(0, 0, 0), Radius=radius_2)
center_box = CenterBox(Base=PlaneXY(0, 0, 0), X=radius_2, Y=width_2, Z=heigth_2)
cap_holes = CapHoles(Brep=cylinder)
stream_filter = StreamFilter(Gate=get_value_list, Stream0=sphere, Stream1=cap_holes, Stream2=center_box)
bounding_box = BoundingBox(Content=stream_filter, Plane=PlaneXY(0, 0, 0))  # -> Box, Box_2
deconstruct_box = DeconstructBox(Box=bounding_box.Box)  # -> Plane, X, Y, Z
unit_z = UnitZ(Factor=deconstruct_box.Z)
number_slider = Slider(2, range=0..10)
move = Move(Geometry=stream_filter, Motion=unit_z)  # -> Geometry, Transform
box_array = BoxArray(
    Geometry=stream_filter,
    Cell={Plane=PlaneXY(0, 0, 0), X=Domain(0, 10), Y=Domain(0, 5), Z=Domain(0, 2)},
    XCount=number_slider,
    YCount=number_slider,
    ZCount=number_slider)  # -> Geometry, Transform
merge = Merge(Data1=stream_filter, Data2=move.Geometry)  # -> flatten(Result)
stream_filter_2 = StreamFilter(Gate=copy_up, Stream0=stream_filter, Stream1=merge)
display = Display(Geo=box_array.Geometry)
display_2 = ContextBake(Content=display)
geometry_to_file = GeometryToFile(Geometry=stream_filter_2, FileNames="Test", FileEnding=".3dm")
area = Area(Geometry=stream_filter_2)  # -> Area, Centroid
bake = ContextBake(Content=geometry_to_file)
print = ContextPrint(Print=area.Area)
