# Grasshopper definition builder_test.gh (Grasshopper 1.0.8)
# plug-ins: ComputeBuilder

number_slider = Slider(10, range=0..20)
number_slider_2 = Slider(10, range=0..100)
get_number_2 = GetNumber(number_slider, AtLeast=1, AtMost=1, Maximum=100, Minimum=10, TreeAccess=False)
num_nu = GetNumber(number_slider, AtLeast=1, AtMost=1, Maximum=100, Minimum=10, TreeAccess=False)
get_string = GetString("fgdffgdfg", AtLeast=1, AtMost=1, TreeAccess=False)
get_boolean = GetBoolean(AtLeast=1, AtMost=1, FalseValue="False", TreeAccess=False, TrueValue="True")
get_integer = GetInteger(AtLeast=1, AtMost=1, Maximum=2147483647, Minimum=-2147483648, TreeAccess=False)
panel = Panel(get_number_2)
panel_2 = Panel(num_nu)
ui_builder = UIBuilder(
    Enable=Toggle(True),
    Refresh=Button(),
    Schema="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",
    SessionId="a8b7f99c",
    Values="{\"12e4b4b9-2767-426b-baa5-0a0e1bcd0a5b\":53,\"e4b0507f-d055-41dc-bef6-95937a79f28c\":false,\"7de6700c-9c1d-4736-b605-c594f497b1b0\":72,\"3a1707e3-f116-4442-8a8d-d66777808bd4\":\"erwrwerwer\",\"3497fb37-9ef8-4b60-b19f-318dd3cdefb7\":31}")  # -> SessionID, Info, Schema
panel_3 = Panel(get_string)
panel_4 = Panel(get_boolean)
panel_5 = Panel(get_integer)
number = Number(num_nu)
clear_context_data = ClearContextData(SessionID=ui_builder.SessionID, Clear=Button())
addition = Addition(A=number, B=Slider(100, range=0..1000))
fgdf = ContextPrint(NumberOutput=addition)
outout = ContextPrint(Text=clear_context_data)
